# Grasshopper definition error_viz_tester_components.ghx (Grasshopper 1.0.8)
# plug-ins: RhinoCodePluginGH, MeshEdit Components, Bifocals

construct_point = ConstructPoint(XCoordinate=Slider(1, range=0..1), YCoordinate=Slider(0, range=0..1), ZCoordinate=Slider(0, range=0..1))
mesh = Mesh(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)
move = Move(Geometry=mesh, Motion=construct_point)  # -> Geometry, Transform
volume = Volume(Geometry=move.Geometry)  # -> Volume, Centroid
scale = Scale(Geometry=move.Geometry, Center=volume.Centroid, Factor=Slider(1.1, range=0..10))  # -> Geometry, Transform
number_slider = Slider(200, range=0..600)
mesh_explode = MeshExplode(Mesh=mesh, Interpolate=False)
mesh_explode_2 = MeshExplode(Mesh=scale.Geometry, Interpolate=False)
populate_geometry = PopulateGeometry(Geometry=mesh_explode_2, Count=number_slider, Seed=Slider(2, range=0..10))  # -> simplify(Population)
populate_geometry_2 = PopulateGeometry(Geometry=mesh_explode, Count=number_slider, Seed=1)
flatten_tree = FlattenTree(Tree=populate_geometry_2, Path="{0}")
flatten_tree_2 = FlattenTree(Tree=populate_geometry, Path="{0}")
point_cloud_attributes = PointCloudAttributes(Locations=flatten_tree)  # -> Cloud, Locations, Normals, Colours, Extra, Hidden
point_cloud_attributes_2 = PointCloudAttributes(Locations=flatten_tree_2)  # -> Cloud, Locations, Normals, Colours, Extra, Hidden
move_2 = Move(Geometry=point_cloud_attributes.Cloud, Motion=Vector(0, 0, 10))  # -> Geometry, Transform

reciprocal = Brep([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])
dfbuildassembly = DFBuildAssembly(i_assembly_name="test", i_breps=reciprocal)  # -> o_assembly; inputs i_assembly_name: String, i_breps: list of Brep
#   port i_assembly_name: The name of the assembly to export.
#   port i_breps: The breps of the structure.
#   port o_assembly: The create DFAssembly object representing the timber elements.
# ---------- dfbuildassembly: Python ----------
#! python3

import System
import typing

import Rhino
import Rhino.Geometry as rg
import scriptcontext as sc

from ghpythonlib.componentbase import executingcomponent as component

import diffCheck
from diffCheck.df_geometries import DFBeam, DFAssembly


class DFBuildAssembly(component):
    def RunScript(self,
            i_assembly_name,
            i_breps : System.Collections.Generic.IList[Rhino.Geometry.Brep]):
        """
            This component parse a series of breps representing a timber structure or a 
            timber elements into a DFAssembly object.
            
            :param i_assembly_name: the name of the assembly
            :param i_breps: list of breps

            :return o_assembly: the DFAssembly object
        """
        beams: typing.List[DFBeam] = []
        for brep in i_breps:
            beam = DFBeam.from_brep_face(brep)
            beams.append(beam)

        o_assembly = DFAssembly(beams, i_assembly_name)

        return o_assembly


# if __name__ == "__main__":
#     comp = DFBuildAssembly()
#     o_assembly = comp.RunScript(
#         i_assembly_name,
#         i_breps
#     )
# ---------- end dfbuildassembly ----------
dfdeconstructassembly = DFDeconstructAssembly(i_assembly=dfbuildassembly)  # -> o_beams
#   port i_assembly: The DFAssembly object to deconstruct.
#   port o_beams: The set of beams contained by this DFAssembly object.
# ---------- dfdeconstructassembly: Python ----------
#! python3

import System
import typing

import Rhino
import Rhino.Geometry as rg
import scriptcontext as sc

from ghpythonlib.componentbase import executingcomponent as component

import diffCheck
from diffCheck.df_geometries import DFBeam, DFAssembly


class DFDeconstructAssembly(component):
    def RunScript(self,
            i_assembly):
        """
            Deconstruct the DFAssembly into a set of df_beams objects.
            
            :param i_assembly: the DFAssembly object

            :return o_beams
        """
        o_beams = i_assembly.beams

        return o_beams


# if __name__ == "__main__":
#     comp = DFDeconstructAssembly()
#     o_beams = comp.RunScript(
#         i_assembly
#     )
# ---------- end dfdeconstructassembly ----------
dfdeconstructbeam = DFDeconstructBeam(i_beams=graft(dfdeconstructassembly))  # -> o_side_faces, o_joint_faces, o_joint_ids; inputs i_beams: list
#   port i_beams: The DFBeam objects to deconstruct.
#   port o_side_faces: The side faces of as Breps of the beam.
#   port o_joint_faces: The faces as Breps belonging to joints of the beam.
#   port o_joint_ids: An integer indicating to which joint the joint faces are belonging to.
# ---------- dfdeconstructbeam: Python ----------
#! python3

import System
import typing

import Rhino
import Rhino.Geometry as rg
import scriptcontext as sc

from ghpythonlib.componentbase import executingcomponent as component

import diffCheck
from diffCheck.df_geometries import DFBeam, DFAssembly


class DFDeconstructBeam(component):
    def RunScript(self,
            i_beams : typing.List[DFBeam]):
        """
            Deconstruct the DFBeam object into Rhino objects.
            
            :param i_beams: the DFBeam objects

            :return o_side_faces: the side joints of the beam
            :return o_joint_faces: the face joints of the beam
            :return o_joint_ids: the ids for each face joint
        """
        o_side_faces, o_joint_faces, o_joint_ids, o_breps = [], [], [], []

        for i_b in i_beams:
            o_side_faces = [f.to_brep_face() for f in i_b.side_faces]
            o_joint_faces = [f.to_brep_face() for f in i_b.joint_faces]
            o_joint_ids = [f.joint_id for f in i_b.joint_faces]

        return o_side_faces, o_joint_faces, o_joint_ids

# if __name__ == "__main__":
#     comp = DFDeconstructBeam()
#     o_side_faces, o_joint_faces, o_joint_ids = comp.RunScript(
#         i_beams
#     )
# ---------- end dfdeconstructbeam ----------
tree_statistics = TreeStatistics(Tree=dfdeconstructbeam.o_side_faces)  # -> Paths, Length, Count
panel = Panel("""0
1
2
3""")
list_item = ListItem(List=tree_statistics.Paths, Index=panel, Wrap=True)
list_item_2 = ListItem(List=dfdeconstructassembly, Index=panel, Wrap=True)
tree_branch = TreeBranch(Tree=dfdeconstructbeam.o_side_faces, Path=list_item, MaintainPaths=True)
tree_branch_2 = TreeBranch(Tree=dfdeconstructbeam.o_joint_faces, Path=list_item, MaintainPaths=True)
populate_geometry_3 = PopulateGeometry(Geometry=[tree_branch, tree_branch_2], Count=number_slider, Seed=1)
trim_tree = TrimTree(Tree=populate_geometry_3, Depth=1)
unit_z = UnitZ(Factor=Slider(0.1, range=0..18))
point_cloud_attributes_3 = PointCloudAttributes(Locations=trim_tree)  # -> Cloud, Locations, Normals, Colours, Extra, Hidden
move_3 = Move(Geometry=flatten(point_cloud_attributes_3.Cloud), Motion=unit_z)  # -> Geometry, Transform

palette = ValueList({"Jet", "Rainbow", "RdPu", "Viridis"}, selected="Rainbow")
valuetype = ValueList({"Dist", "MSE", "MAX", "MIN", "STD"}, selected="Dist")
palette_2 = ValueList({"Jet", "Rainbow", "RdPu", "Viridis"}, selected="RdPu")
valuetype_2 = ValueList({"Dist", "MSE", "MAX", "MIN", "STD"}, selected="Dist")
point = Point(Point(13.91317868, 0, 0))
xy_plane = XYPlane(Origin=point)
df_beam = Data(list_item_2)
xy_plane_2 = XYPlane(Origin=Point(0, 0, 0))
panel_2 = Panel("diffCheck")
point_cloud = PointCloud([point_cloud_attributes.Cloud, move_2.Geometry])
point_cloud_2 = PointCloud([point_cloud_attributes_2.Cloud, move_2.Geometry])
dfvisualizationsettings = DFVisualizationSettings(
    i_value_type=valuetype_2,
    i_palette=palette_2,
    i_legend_height=Slider(10, range=0..10),
    i_legend_width=Slider(0.6, range=0..1),
    i_legend_plane=xy_plane_2,
    i_histogram_scale_factor=Slider(0.002, range=0..0.01))  # -> o_viz_settings; inputs i_value_type: String, i_upper_threshold: Double, i_lower_threshold: Double, i_palette: String, i_legend_height: Double, i_legend_width: Double, i_legend_plane: Plane, i_histogram_scale_factor: Double
#   port i_legend_height: Set the total height of the legend
#   port i_legend_width: Set the total width of the legend
#   port i_legend_plane: A construction plane for the legend
#   port o_viz_settings: Settings to be passed to the Visualization component
# ---------- dfvisualizationsettings: Python ----------
#! python3

import System
import typing

import Rhino
import Rhino.Geometry as rg
from ghpythonlib.componentbase import executingcomponent as component

import Grasshopper as gh
from Grasshopper.Kernel import GH_RuntimeMessageLevel as RML

from diffCheck import df_visualization

class VisualizationSettings(component):
    def RunScript(self,
        i_value_type: str,
        i_upper_threshold: float,
        i_lower_threshold: float,
        i_palette: str,
        i_legend_height: float,
        i_legend_width: float,
        i_legend_plane: rg.Plane,
        i_histogram_scale_factor: float):

        """
        Compiles all the visualization settings to feed to the visualization component

        :param i_value_type: selected type indicates Which values to display. Possible values: "dist", "RMSE", "MAX", "MIN", "STD"
        :param i_upper_threshold: Thresholds the values with a maximum value
        :param i_lower_threshold: Thresholds the values with a minimum value
        :param i_palette: Select a color palette to map the values to. Possible values: "Jet", "Rainbow", "RdPu", "Viridis"
        :param i_legend_height: the total height of the legend
        :param i_legend_width: the total width of the legend
        :param i_legend_plane: the construction plane of the legend
        :param i_histogram_scale_factor: Scales the height of the histogram with a factor

        :returns o_viz_settings: the results of the comparison all in one object
        """

        
        if i_palette not in  ["Jet", "Rainbow", "RdPu", "Viridis"]:
            ghenv.Component.AddRuntimeMessage(RML.Warning, "Possible values for i_palette are: Jet, Rainbow, RdPu, Viridis")
            return None
        
        if i_value_type not in  ["Dist", "RMSE", "MAX", "MIN", "STD"]:
            ghenv.Component.AddRuntimeMessage(RML.Warning, "Possible values for i_value_type are: dist, RMSE, MAX, MIN, STD")
            return None
        
        # set default values
        if i_legend_height is None: i_legend_height = 10
        if i_legend_width is None: i_legend_width = 0.5
        if i_legend_plane is None: i_legend_plane = rg.Plane.WorldXY
        if i_histogram_scale_factor is None: i_histogram_scale_factor = 0.01

        # pack settings
        o_viz_settings = df_visualization.DFVizSettings(i_value_type,
                                                        i_upper_threshold,
                                                        i_lower_threshold,
                                                        i_palette,
                                                        i_legend_height,
                                                        i_legend_width,
                                                        i_legend_plane,
                                                        i_histogram_scale_factor)

        return o_viz_settings

# if __name__ == "__main__":
#     com = VisualizationSettings()
#     o_viz_settings = com.RunScript(
#         i_value_type,
#         i_upper_threshold,
#         i_lower_threshold,
#         i_palette,
#         i_legend_height,
#         i_legend_width,
#         i_legend_plane,
#         i_histogram_scale_factor
#         )
# ---------- end dfvisualizationsettings ----------
dfcloudclouddistance = DFCloudCloudDistance(i_cloud_source=point_cloud, i_cloud_target=point_cloud_2, i_swap=Toggle(False))  # -> o_distances, o_rmse, o_max_deviation, o_min_deviation, o_std_deviation, o_result; inputs i_cloud_source: list, i_cloud_target: list, i_swap: Boolean
#   port i_cloud_source: The source point cloud.
#   port i_cloud_target: The target cloud.
#   port i_swap: whether to swap source and target
#   port o_result: The result of the distance calculation.
# ---------- dfcloudclouddistance: Python ----------
#! python3

import System
import typing

import Rhino
import Rhino.Geometry as rg
from ghpythonlib.componentbase import executingcomponent as component

import Grasshopper as gh
from Grasshopper.Kernel import GH_RuntimeMessageLevel as RML

import diffCheck
from diffCheck import df_cvt_bindings
from diffCheck import df_error_estimation

import diffCheck.df_util


class CloudCloudDistance(component):
    def RunScript(self,
        i_cloud_source:  typing.List[rg.PointCloud],
        i_cloud_target: typing.List[rg.PointCloud],
        i_swap: bool):
        """
            The cloud-to-cloud component computes the distance between each point in the source point cloud and its nearest neighbour in thr target point cloud.

            :param i_cloud_source: a list of source point cloud
            :param i_cloud_target: a list of target point cloud to calculate distances to

            :return o_distances : list of calculated distances for each point
            :return o_rmse: the root mean squared error between corresponding points of source and target
            :return o_max_deviation: the max deviation between source and target
            :return o_min_deviation: the min deviation between source and target
            :return o_std_deviation: the standard deviation between source and target
            :returns o_resluts: the results of the comparison all in one object
        """

        if i_cloud_source is None or i_cloud_target is None:
            ghenv.Component.AddRuntimeMessage(RML.Warning, "Please provide both objects of type point clouds to compare")
            return None

        # swap
        if i_swap is True:
            temp = i_cloud_source
            i_cloud_source = i_cloud_target
            i_cloud_target = temp

        # conversion
        df_cloud_source_list = [df_cvt_bindings.cvt_rhcloud_2_dfcloud(i_cl_s) for i_cl_s in i_cloud_source]
        df_cloud_target_list = [df_cvt_bindings.cvt_rhcloud_2_dfcloud(i_cl_t) for i_cl_t in i_cloud_target]

        # calculate distances
        o_results = df_error_estimation.df_cloud_2_df_cloud_comparison(df_cloud_source_list, df_cloud_target_list)

        return o_results.distances, o_results.distances_rmse, o_results.distances_max_deviation, o_results.distances_min_deviation, o_results.distances_sd_deviation, o_results


# if __name__ == "__main__":
#     com = CloudCloudDistance()
#     o_distances, o_rmse, o_max_deviation, o_min_deviation, o_std_deviation, o_results = com.RunScript(
#         i_cloud_source,
#         i_cloud_target,
#         i_swap
#         )
# ---------- end dfcloudclouddistance ----------
dfvisualizationsettings_2 = DFVisualizationSettings(
    i_value_type=valuetype,
    i_palette=palette,
    i_legend_height=Slider(10, range=0..10),
    i_legend_width=Slider(0.6, range=0..1),
    i_legend_plane=xy_plane,
    i_histogram_scale_factor=Slider(0.001, range=0..0.01))  # -> o_viz_settings; inputs i_value_type: String, i_upper_threshold: Double, i_lower_threshold: Double, i_palette: String, i_legend_height: Double, i_legend_width: Double, i_legend_plane: Plane, i_histogram_scale_factor: Double; same code as dfvisualizationsettings
dfcloudmeshdistance = DFCloudMeshDistance(
    i_cloud_source=move_3.Geometry,
    i_beams=df_beam,
    i_signed_flag=Toggle(False),
    i_swap=Toggle(True),
    i_analysis_resolution=Slider(0.258, range=0..1))  # -> o_distances, o_rmse, o_max_deviation, o_min_deviation, o_std_deviation, o_result; inputs i_cloud_source: list, i_beams: list, i_signed_flag: Boolean, i_swap: Boolean, i_analysis_resolution: Double
#   port i_cloud_source: The source point cloud.
#   port i_beams: The target DFbeams
#   port i_signed_flag: whether to consider the sign of the distances
#   port i_swap: whether to swap source and target
#   port i_analysis_resolution: the maximum edge length of the mesh that is used for the distance calculation
#   port o_rmse: average squared difference between source and target.
#   port o_std_deviation: standard deviation between source and target.
#   port o_result: The result of the distance calculation.
# ---------- dfcloudmeshdistance: Python ----------
#! python3

import System
import typing

import Rhino
import Rhino.Geometry as rg
from ghpythonlib.componentbase import executingcomponent as component

import Grasshopper as gh
from Grasshopper.Kernel import GH_RuntimeMessageLevel as RML

import diffCheck
from diffCheck import df_cvt_bindings
from diffCheck import df_error_estimation
from diffCheck.df_geometries import DFBeam


class CloudMeshDistance(component):
    def RunScript(self,
        i_cloud_source: typing.List[rg.PointCloud],
        i_beams: typing.List[DFBeam],
        i_signed_flag: bool,
        i_swap: bool,
        i_analysis_resolution):

        """
            The cloud-to-mesh component computes the distance between a point cloud and a mesh

            :param i_cloud_source: a list of point clouds
            :param i_beams: a list of DF beams
            :param i_signed_flag: calculate the sign of the distances
            :param i_swap: swap source and target

            :return o_distances : list of calculated distances for each point
            :return o_rmse: the root mean square error between corresponding points of source and target
            :return o_max_deviation: the max deviation between source and target
            :return o_min_deviation: the min deviation between source and target
            :returns o_results: the results of the comparison all in one object
        """
        if i_analysis_resolution is None:
            scalef = diffCheck.df_util.get_doc_2_meters_unitf()
            i_analysis_resolution = 0.1 / scalef

        # conversion
        df_cloud_source_list = [df_cvt_bindings.cvt_rhcloud_2_dfcloud(i_cl_s) for i_cl_s in i_cloud_source]
        rh_mesh_target_list = [beam.to_mesh(i_analysis_resolution) for beam in i_beams]

        # calculate distances
        o_result = df_error_estimation.df_cloud_2_rh_mesh_comparison(df_cloud_source_list, rh_mesh_target_list, i_signed_flag, i_swap)

        return o_result.distances, o_result.distances_rmse, o_result.distances_max_deviation, o_result.distances_min_deviation, o_result.distances_sd_deviation, o_result


# if __name__ == "__main__":
#     com = CloudMeshDistance()
#     o_distances, o_rmse, o_max_deviation, o_min_deviation, o_std_deviation, o_results = com.RunScript(
#         i_cloud_source,
#         i_beams,
#         i_signed_flag,
#         i_swap,
#         i_analysis_resolution
#         )
# ---------- end dfcloudmeshdistance ----------
dfvisualization = DFVisualization(i_result=dfcloudclouddistance.o_result, i_viz_settings=dfvisualizationsettings_2)  # -> o_colored_geo, o_legend, o_histogram
#   port i_result: The result of the distance calculation
#   port i_viz_settings: The settings of the visualization
#   port o_colored_geo: The geometry colored according to the distance results.
#   port o_legend: The legend of the visualization
#   port o_histogram: Histogram that shows the frequency of the values
# ---------- dfvisualization: Python ----------
#! python3

import System
import typing

import Rhino
import Rhino.Geometry as rg
from ghpythonlib.componentbase import executingcomponent as component

import Grasshopper as gh
from Grasshopper.Kernel import GH_RuntimeMessageLevel as RML

from diffCheck import df_cvt_bindings
from diffCheck import df_visualization
from diffCheck.df_visualization import DFVizSettings
from diffCheck.df_error_estimation import DFVizResults
from diffCheck import diffcheck_bindings

class Visualization(component):
    def RunScript(self,
                  i_result: DFVizResults,
                  i_viz_settings: DFVizSettings):

        """
            Adds color to the mesh or point cloud
            and generates a corresponding legend and histogram

            :param i_result: a list of point clouds
            :param i_viz_settings: a list of DF beams

            :return o_colored_geo: the colored mesh or point cloud
            :return o_legend : the correesponding legend of the coloring
            :return o_histogram : a histogram that represents the frequency of the values
        """

        values, min_value, max_value = i_result.filter_values_based_on_valuetype(i_viz_settings)

        # check if i_result.source is a list of pointclouds or a mesh
        if type(i_result.source[0]) is diffcheck_bindings.dfb_geometry.DFPointCloud:

            # convert to Rhino PCD
            o_source = [df_cvt_bindings.cvt_dfcloud_2_rhcloud(src) for src in i_result.source]

            # color geometry
            o_colored_geo = [df_visualization.color_rh_pcd(src, dist, min_value, max_value, i_viz_settings.palette) for src, dist in zip(o_source, values)]

        elif type(i_result.source[0]) is rg.Mesh:
            # convert to Rhino Mesh
            o_source = i_result.source

            # color geometry
            o_colored_geo = [df_visualization.color_rh_mesh(src, dist, min_value, max_value, i_viz_settings.palette) for src, dist in zip(o_source, values)]

        o_legend = df_visualization.create_legend(min_value,
                                                  max_value,
                                                  i_viz_settings.palette,
                                                  steps=10,
                                                  plane=i_viz_settings.legend_plane,
                                                  width=i_viz_settings.legend_width,
                                                  total_height=i_viz_settings.legend_height)

        o_histogram = df_visualization.create_histogram(values,
                                                        min_value,
                                                        max_value,
                                                        steps=100,
                                                        plane=i_viz_settings.legend_plane,
                                                        total_height=i_viz_settings.legend_height,
                                                        scaling_factor=i_viz_settings.histogram_scale_factor)

        return o_colored_geo, o_legend, o_histogram


# if __name__ == "__main__":
#     com = Visualization()
#     o_colored_geo, o_legend, o_histogram  = com.RunScript(
#         i_result,
#         i_viz_settings
#         )
# ---------- end dfvisualization ----------
dfvisualization_2 = DFVisualization(i_result=dfcloudmeshdistance.o_result, i_viz_settings=dfvisualizationsettings)  # -> o_colored_geo, o_legend, o_histogram; same code as dfvisualization
file_path = FilePath("C:\Users\eleni\Desktop\DC\temp")
dfcsvexporter = DFCsvExporter(
    i_dump=Button(),
    i_export_dir=file_path,
    i_file_name="assembly",
    i_export_seperate_files=Toggle(True),
    i_result=dfcloudclouddistance.o_result)  # -> o_success; inputs i_dump: Boolean, i_export_dir: String, i_file_name: String, i_export_seperate_files: Boolean
#   port i_file_name: The name for the file.
#   port i_export_seperate_files: Whether to export one single file or seperate files per element.
#   port i_result: The result of the distance calculation to export
#   port o_success: Whether the values exported successfully
# ---------- dfcsvexporter: Python ----------
#! python3

import System
import typing

import Rhino
import Rhino.Geometry as rg
from ghpythonlib.componentbase import executingcomponent as component

import Grasshopper as gh
from Grasshopper.Kernel import GH_RuntimeMessageLevel as RML
from diffCheck.df_error_estimation import DFVizResults
import csv
import os


class CsvExporter(component):
    def RunScript(self,
        i_dump: bool,
        i_export_dir: str,
        i_file_name: str,
        i_export_seperate_files: bool,
        i_result: DFVizResults):
        """
            The csv-exporter component exports a list of values to a .csv file

            :param i_dump: A flag indicating whether to perform the export.
            :param i_export_dir: The directory where the CSV file will be saved.
            :param i_file_name: The name of the file
            :param i_export_seperate_files: whether to export a different file for each part
            :param i_values: A list of values to be exported.

            :return o_success: A string notifying the user for the successful export
        """
        if i_dump:
            # Ensure the export directory exists
            os.makedirs(i_export_dir, exist_ok=True)

            if i_export_seperate_files:
                # Export each list of values to a separate file
                for idx, list_of_values in enumerate(i_result.distances):
                    file_name = f"{i_file_name}_{idx + 1}.csv"
                    file_path = os.path.join(i_export_dir, file_name)
                    with open(file_path, mode='w', newline='') as file:
                        writer = csv.writer(file)
                        writer.writerow([list_of_values])
            else:
                # Export all values to a single file
                file_path = os.path.join(i_export_dir, f"{i_file_name}.csv")
                with open(file_path, mode='w', newline='') as file:
                    writer = csv.writer(file)
                    for list_of_values in i_result.distances:
                        writer.writerow([list_of_values])

            o_success = "Successfully exported the values"

            return o_success


# if __name__ == "__main__":
#     com = CsvExporter()
#     o_cvs = com.RunScript(
#         i_dump,
#         i_export_dir,
#         i_file_name,
#         i_export_seperate_files,
#         i_results
#     )
# ---------- end dfcsvexporter ----------
